# Grasshopper definition BEEHOME.gh (Grasshopper 1.0.7)
# plug-ins: Heteroptera, Squid (ShapeDiver Edition), Pufferfish, OpenNest, ShapeDiver

# ---- group: GEOMETRIES / REFERENCING GEOMETRIES / ROOF
p_roof = Geometry([<curve referenced from the Rhino model> x9, <brep referenced from the Rhino model>, <curve referenced from the Rhino model>])
a_roof = Geometry([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])
o_roof = Geometry([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])
n_roof = Geometry([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])
m_roof = Geometry([<curve referenced from the Rhino model> x2, <brep referenced from the Rhino model>, <curve referenced from the Rhino model> x4])
l_roof = Geometry([<curve referenced from the Rhino model> x13, <brep referenced from the Rhino model>, <curve referenced from the Rhino model> x3])
k_roof = Geometry([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])
j_roof = Geometry([<curve referenced from the Rhino model> x8, <brep referenced from the Rhino model>])
i_roof = Geometry([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])
e_roof = Geometry([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])
c_roof = Geometry([<curve referenced from the Rhino model> x7, <brep referenced from the Rhino model>])
b_roof = Geometry([<curve referenced from the Rhino model> x2, <brep referenced from the Rhino model>, <curve referenced from the Rhino model> x6])
h_roof = Geometry([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])
g_roof = Geometry([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])
f_roof = Geometry([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])
d_roof = Geometry([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])
entwine = Entwine(
    Branch00=p_roof,
    Branch01=o_roof,
    Branch02=n_roof,
    Branch03=m_roof,
    Branch04=l_roof,
    Branch05=k_roof,
    Branch06=j_roof,
    Branch07=i_roof,
    Branch08=h_roof,
    Branch09=g_roof,
    Branch010=f_roof,
    Branch011=e_roof,
    Branch012=d_roof,
    Branch013=c_roof,
    Branch014=b_roof,
    Branch015=a_roof,
    FlattenInputs=True)  # -> simplify(Result)

# ---- group: GEOMETRIES / REFERENCING GEOMETRIES / FIXED
a_fixed = Geometry([<brep referenced from the Rhino model>, <curve referenced from the Rhino model> x8])
o_fixed = Geometry([<brep referenced from the Rhino model>, <curve referenced from the Rhino model> x8])
n_fixed = Geometry([<brep referenced from the Rhino model>, <curve referenced from the Rhino model> x10])
m_fixed = Geometry([<brep referenced from the Rhino model>, <curve referenced from the Rhino model> x9])
l_fixed = Geometry([<curve referenced from the Rhino model> x14, <brep referenced from the Rhino model>, <curve referenced from the Rhino model> x3])
k_fixed = Geometry([<brep referenced from the Rhino model>, <curve referenced from the Rhino model> x10])
j_fixed = Geometry([<brep referenced from the Rhino model>, <curve referenced from the Rhino model> x11])
i_fixed = Geometry([<brep referenced from the Rhino model>, <curve referenced from the Rhino model> x10])
b_fixed = Geometry([<curve referenced from the Rhino model> x2, <brep referenced from the Rhino model>, <curve referenced from the Rhino model> x9])
p_fixed = Geometry([<curve referenced from the Rhino model>, <brep referenced from the Rhino model>, <curve referenced from the Rhino model> x11])
h_fixed = Geometry([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])
g_fixed = Geometry([<brep referenced from the Rhino model>, <curve referenced from the Rhino model> x10])
f_fixed = Geometry([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])
e_fixed = Geometry([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])
d_fixed = Geometry([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])
c_fixed = Geometry([<brep referenced from the Rhino model>, <curve referenced from the Rhino model> x10])
entwine_2 = Entwine(
    Branch00=p_fixed,
    Branch01=o_fixed,
    Branch02=n_fixed,
    Branch03=m_fixed,
    Branch04=l_fixed,
    Branch05=k_fixed,
    Branch06=j_fixed,
    Branch07=i_fixed,
    Branch08=h_fixed,
    Branch09=g_fixed,
    Branch010=f_fixed,
    Branch011=e_fixed,
    Branch012=d_fixed,
    Branch013=c_fixed,
    Branch014=b_fixed,
    Branch015=a_fixed,
    FlattenInputs=True)  # -> simplify(Result)

# ---- group: GEOMETRIES / REFERENCING GEOMETRIES / DEFAULT
m_default = Geometry([<curve referenced from the Rhino model> x2, <brep referenced from the Rhino model>, <curve referenced from the Rhino model> x4])
a_default = Geometry([<brep referenced from the Rhino model>, <curve referenced from the Rhino model> x4])
o_default = Geometry([<brep referenced from the Rhino model>, <curve referenced from the Rhino model> x4])
n_default = Geometry([<brep referenced from the Rhino model>, <curve referenced from the Rhino model> x6])
h_default = Geometry([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])
d_default = Geometry([<brep referenced from the Rhino model>, <curve referenced from the Rhino model> x4])
c_default = Geometry([<brep referenced from the Rhino model>, <curve referenced from the Rhino model> x7])
p_default = Geometry([<curve referenced from the Rhino model>, <brep referenced from the Rhino model>, <curve referenced from the Rhino model> x9])
l_default = Geometry([<brep referenced from the Rhino model>, <curve referenced from the Rhino model> x16])
k_default = Geometry([<brep referenced from the Rhino model>, <curve referenced from the Rhino model> x6])
g_default = Geometry([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])
e_default = Geometry([<brep referenced from the Rhino model>, <curve referenced from the Rhino model> x6])
b_default = Geometry([<curve referenced from the Rhino model> x2, <brep referenced from the Rhino model>, <curve referenced from the Rhino model> x6])
j_default = Geometry([<brep referenced from the Rhino model>, <curve referenced from the Rhino model> x8])
i_default = Geometry([<brep referenced from the Rhino model>, <curve referenced from the Rhino model> x6])
f_default = Geometry([<brep referenced from the Rhino model>, <curve referenced from the Rhino model> x4])
entwine_3 = Entwine(
    Branch00=p_default,
    Branch01=o_default,
    Branch02=n_default,
    Branch03=m_default,
    Branch04=l_default,
    Branch05=k_default,
    Branch06=j_default,
    Branch07=i_default,
    Branch08=h_default,
    Branch09=g_default,
    Branch010=f_default,
    Branch011=e_default,
    Branch012=d_default,
    Branch013=c_default,
    Branch014=b_default,
    Branch015=a_default,
    FlattenInputs=True)  # -> simplify(Result)

# ---- group: GEOMETRIES / REFERENCING GEOMETRIES
roof_input_geometries = DEFAULTINPUTGEOMETRIES(geo=entwine)
# To update the goemetries, connect the components accordingly and internalise the geometries to the right.
fixed_input_geometries = DEFAULTINPUTGEOMETRIES(geo=entwine_2)
default_input_geometries = DEFAULTINPUTGEOMETRIES(geo=entwine_3)

# ---- group: FILE LOCATION
panel = Panel("NC_FILES")

# ---- group: Stay True
show_export = BooleanToggle(True)
export_dxf = BooleanToggle(False)
production = BooleanToggle(True)

# ---- group: Show Beehome Components
show_special_features = BooleanToggle(True)

# ---- group: BeeHome Input
panel_2 = Panel("03AAAAAAAB")

# ---- group: GEOMETRIES / STATIC GEO
roof = Geometry(Tree({0;0;0}: [{Plane=PlaneXY(0, 0, 0), X=Domain(399, 519), Y=Domain(5199.999879, 5359.999879), Z=Domain(2462.745361, 2492.745434)}, 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], {1;0;0}: [{Plane=PlaneXY(0, 0, 0), X=Domain(399, 519), Y=Domain(5399.999879, 5559.999879), Z=Domain(2432.745288, 2462.745361)}, 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], {2;0;0}: [{Plane=PlaneXY(0, 0, 0), X=Domain(399, 519), Y=Domain(5599.999879, 5759.999879), Z=Domain(2402.745215, 2432.745288)}, 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], {3;0;0}: [{Plane=PlaneXY(0, 0, 0), X=Domain(399, 519), Y=Domain(5799.999879, 5959.999879), Z=Domain(2372.745142, 2402.745215)}, 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], {4;0;0}: [{Plane=PlaneXY(0, 0, 0), X=Domain(399, 519), Y=Domain(5999.999879, 6159.999879), Z=Domain(2342.745434, 2372.745434)}, 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], {5;0;0}: [{Plane=PlaneXY(0, 0, 0), X=Domain(399, 519), Y=Domain(6199.999879, 6359.999879), Z=Domain(2312.744996, 2342.745069)}, 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]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))
default = Geometry(Tree({0;0;0}: [{Plane=PlaneXY(0, 0, 0), X=Domain(-0.9996210911, 119.0003789), Y=Domain(5200, 5360), Z=Domain(1348.365589, 1378.365662)}, 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], {1;0;0}: [{Plane=PlaneXY(0, 0, 0), X=Domain(-0.9996210911, 119.0003789), Y=Domain(5400, 5560), Z=Domain(1318.365516, 1348.365589)}, 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], {2;0;0}: [{Plane=PlaneXY(0, 0, 0), X=Domain(-0.9996210911, 119.0003789), Y=Domain(5600, 5760), Z=Domain(1288.365443, 1318.365516)}, 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], {3;0;0}: [{Plane=PlaneXY(0, 0, 0), X=Domain(-0.9996210911, 119.0003789), Y=Domain(5800, 5960), Z=Domain(1258.36537, 1288.365443)}, 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], {4;0;0}: [{Plane=PlaneXY(0, 0, 0), X=Domain(-0.9996210911, 119.0003789), Y=Domain(6000, 6160), Z=Domain(1228.365662, 1258.365662)}, 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], {5;0;0}: [{Plane=PlaneXY(0, 0, 0), X=Domain(-0.9996210911, 119.0003789), Y=Domain(6200, 6360), Z=Domain(1198.365224, 1228.365297)}, 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]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))
fixed = Geometry(Tree({0;0;0}: [{Plane=PlaneXY(0, 0, 0), X=Domain(199.0016855, 319.0016855), Y=Domain(5199.999879, 5359.999879), Z=Domain(1910.567161, 1940.567234)}, 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], {1;0;0}: [{Plane=PlaneXY(0, 0, 0), X=Domain(199.0016855, 319.0016855), Y=Domain(5399.999879, 5559.999879), Z=Domain(1880.567088, 1910.567161)}, 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], {2;0;0}: [{Plane=PlaneXY(0, 0, 0), X=Domain(199.0016855, 319.0016855), Y=Domain(5599.999879, 5759.999879), Z=Domain(1850.567015, 1880.567088)}, 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], {3;0;0}: [{Plane=PlaneXY(0, 0, 0), X=Domain(199.0016855, 319.0016855), Y=Domain(5799.999879, 5959.999879), Z=Domain(1820.566942, 1850.567015)}, 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], {4;0;0}: [{Plane=PlaneXY(0, 0, 0), X=Domain(199.0016855, 319.0016855), Y=Domain(5999.999879, 6159.999879), Z=Domain(1790.567234, 1820.567234)}, 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], {5;0;0}: [{Plane=PlaneXY(0, 0, 0), X=Domain(199.0016855, 319.0016855), Y=Domain(6199.999879, 6359.999879), Z=Domain(1760.566796, 1790.566869)}, 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]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))
fixed_2 = Group(Objects=fixed)  # -> flatten(Group)
default_2 = Group(Objects=default)  # -> flatten(Group)
roof_2 = Group(Objects=roof)  # -> flatten(Group)
rev = ReverseList(List=roof_2)
rev_2 = ReverseList(List=default_2)
rev_3 = ReverseList(List=fixed_2)

# ---- group: ShapeDiverInputs
flatslist = ShapeDiverTextInput(maxlength=100, text="BASE_STANDING,A1,A2")
cluster = Cluster(T=flatslist)
split = TextSplit(Text=cluster, Separators=",")

# ---- group: PART NUMBER ANALYZER
filter = StreamFilter(Gate=production, Stream0=flatslist, Stream1=panel_2)
python = GhPythonScript(x=filter)  # -> type, height, secondLast, lastLetter, rest
# ---------- python: Python ----------
__author__ = "mortenydefeldt"
__version__ = "2020.05.25"
import re
#parts = re.split('(\d+)',x)
#print(parts[0])

match = re.match(r"([0-9]+)([A-Z]+)", x, re.I)
items = match.groups()
print(items)

numbers = items[0]
letters = items[1]

type = numbers[0:2]
height = numbers[2:]
lastLetter = letters[len(letters)-1:len(letters)]
secondLast = letters[len(letters)-2:len(letters)-1]
rest = letters[0:len(letters)-2]
# ---------- end python ----------
concat = Concatenate(FragmentA=python.rest, FragmentB=python.secondLast, FragmentC=python.lastLetter)

# ---- group: BOTTOM STORIES
panel_3 = Panel("BASE_STANDING")
panel_4 = Panel("BASE_FIXED")
panel_5 = Panel("BASE_GROUNDED")
geo = Geometry([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, Point(59.00168554, 98.10987901, 2558.535951)])
geo_2 = Geometry([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, Point(59.00168554, 23.00987901, 2843.516824), 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])
geo_3 = Geometry([Point(59.00168554, 23.00987901, 2677.70269), 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])
group = Group(Objects=geo)
group_2 = Group(Objects=geo_2)
group_3 = Group(Objects=geo_3)
filter_2 = StreamFilter(Gate=python.type, Stream1=group, Stream2=group_2, Stream3=group_3)  # -> flatten(Stream)

# ---- group: IF HANGING SWAP SECOND TO LAST ITEM
python_2 = GhPythonScript(letters=python.secondLast)  # -> simplify(numbers)
# ---------- python_2: Python ----------
__author__ = "morte"
__version__ = "2020.04.16"

import rhinoscriptsyntax as rs

numbers = []
for letter in letters:
  number = ord(letter) - 96 + 31
  numbers.append(number)
# ---------- end python_2 ----------
item = ListItem(List=rev_2, Index=python_2, Wrap=True)
item_2 = ListItem(List=rev_3, Index=python_2, Wrap=True)
equals = Equality(FirstNumber=python.type, SecondNumber=3)  # -> Equality, Inequality
filter_3 = StreamFilter(Gate=equals.Equality, Stream0=item, Stream1=item_2)  # -> simplify(Stream)

# ---- group: THE STANDARD STORYES
python_3 = GhPythonScript(letters=python.rest)  # -> simplify(numbers); same code as python_2
item_3 = ListItem(List=flatten(rev_2), Index=python_3, Wrap=True)  # -> simplify(Item)

# ---- group: ROOF
python_4 = GhPythonScript(letters=python.lastLetter)  # -> simplify(numbers); same code as python_2
item_4 = ListItem(List=rev, Index=python_4, Wrap=True)

# ---- group: Peg
geo_4 = Geometry([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])
group_4 = Group(Objects=geo_4)
filter_4 = StreamFilter(Gate=show_special_features, Stream1=group_4)

# ---- group: Spine
len = TextLength(Text=concat)  # -> expr("x-2", Length)
newspine = NewSpine(A=len)  # -> curve, brep
merge = Merge(Data1=newspine.brep, Data2=newspine.curve)
geo_5 = Geometry(merge)
group_5 = Group(Objects=geo_5)
filter_5 = StreamFilter(Gate=show_special_features, Stream1=group_5)

# ---- group: Standing
legs = Legs(A=python.height)  # -> graft(D), graft(D_2)
merge_2 = Merge(Data1=legs.D_2, Data2=legs.D)
geo_6 = Geometry(merge_2)
group_6 = Group(Objects=geo_6)
filter_6 = StreamFilter(Gate=show_special_features, Stream1=group_6)

# ---- group: Spike
spike = Spike(F=python.height)  # -> curve, _3dspine
merge_3 = Merge(Data1=spike._3dspine, Data2=spike.curve)
geo_7 = Geometry(merge_3)
group_7 = Group(Objects=geo_7)
filter_7 = StreamFilter(Gate=show_special_features, Stream1=group_7)

# ----
merge_4 = Merge(Data2=flatten(item_4), Data3=flatten(filter_3), Data4=reverse(flatten(item_3)), Data5=flatten(filter_2))
filter_8 = StreamFilter(Gate=python.type, Stream1=filter_6, Stream2=filter_7)
rotate = Rotate(Geometry=merge_4, Angle=1.570796327, Plane=PlaneXY(0, 0, 0))  # -> Geometry, Transform

# ---- group: Geometry To Assemble
merge_5 = Merge(Data3=filter_8, Data4=rotate.Geometry)  # -> flatten(Result)
rotate_2 = Rotate(Geometry=flatten(merge_5), Angle=3.141592654, Plane=PlaneYZ(0, 0, 0))  # -> Geometry, Transform
data = Data(rotate_2.Geometry)
movegeometrytozero = MoveGeometryToZero(C=data)
move2pt = MoveToPoint(Geometry=data, PointA=movegeometrytozero, PointB=Point(0, 0, 0))  # -> Moved, Vector, Transform
ungroup = Ungroup(Group=move2pt.Moved)

# ---- group: GEOMETRY TO PRODUCE
merge_6 = Merge(Data1=filter_4, Data2=filter_5, Data3=filter_8, Data4=rotate.Geometry)  # -> flatten(Result)
rotate_3 = Rotate(Geometry=flatten(merge_6), Angle=3.141592654, Plane=PlaneYZ(0, 0, 0))  # -> Geometry, Transform

# ---- group: ShapeDiverStock
pt = ConstructPoint(XCoordinate=expr("x+40", [240, 450, 660]), YCoordinate=expr("x+40", 0), ZCoordinate=0)
sheetswidth = ShapeDiverTextInput(maxlength=1000, text="230")
sheetslength = ShapeDiverTextInput(maxlength=100, text="2000")
rectangle = Rectangle(Plane=pt, XSize=sheetswidth, YSize=sheetslength, Radius=0)  # -> Rectangle, Length
crv = Curve(rectangle.Rectangle)

# ---- group: DYNAMIC LAYER STOCK
pipeline = GeometryPipeline(
    GroupByLayer=False,
    GroupByType=False,
    IncludeHidden=True,
    IncludeLocked=True,
    LayerFilter="STOCK",
    NameFilter="*",
    SublayerFiltering=True,
    TypeFilter=4)
geo_8 = Geometry(pipeline)

# ----
filter_9 = StreamFilter(Gate=production, Stream0=crv, Stream1=geo_8)

# ---- group: NESTING
data_2 = Data(rotate_3.Geometry)
movegeometrytozero_2 = MoveGeometryToZero(C=data_2)
nestspacing = Slider(23.665, range=0..50)
move2pt_2 = MoveToPoint(Geometry=data_2, PointA=movegeometrytozero_2, PointB=Point(0, 0, 0))  # -> Moved, Vector, Transform
cluster_2 = Cluster_2(C=move2pt_2.Moved)
opennest = OpenNest(
    Sheets=filter_9,
    Geo=cluster_2,
    Spacing=nestspacing,
    Placement=1,
    Tolerance=0.1,
    Rotations=2,
    Iterations=1,
    Seed=1,
    Reset=True,
    Run=False)  # -> Sheets, Geo, ID, Transform, IDS
transform = Transform(Geometry=move2pt_2.Moved, Transform=opennest.Transform)
ungroup_2 = Ungroup(Group=transform)

# ----
lng = ListLength(List=filter_9)
crv_2 = Curve(ungroup)

# ---- group: ASSEMBLY / PREPARING DATA
clean = CleanTree(RemoveNulls=True, RemoveInvalid=True, RemoveEmpty=False, Tree=crv_2)
frame = CurveFrame(Curve=reparameterize(clean), Parameter="0")
pdecon = Deconstruct(Point=frame)  # -> XComponent, YComponent, ZComponent
expression = Expression(x=pdecon.ZComponent, Expression="Format (\"{0:0.0}\",x}")
equals_2 = Equality(FirstNumber=expression, SecondNumber="0")  # -> Equality, Inequality

# ---- group: Casting Geometry
crv_3 = Curve(ungroup_2)
brep = Brep(ungroup_2)
pt_2 = Point(ungroup_2)

# ---- group: PREPARING DATA
clean_2 = CleanTree(RemoveNulls=True, RemoveInvalid=True, RemoveEmpty=False, Tree=crv_3)
frame_2 = CurveFrame(Curve=reparameterize(clean_2), Parameter="0")
pdecon_2 = Deconstruct(Point=frame_2)  # -> XComponent, YComponent, ZComponent
expression_2 = Expression(x=pdecon_2.ZComponent, Expression="Format (\"{0:0.0}\",x}")
equals_3 = Equality(FirstNumber=expression_2, SecondNumber="0")  # -> Equality, Inequality

# ---- group: ASSEMBLY / PREPARING DATA / GEOMETRY
dispatch = Dispatch(List=clean, DispatchPattern=equals_2.Equality)  # -> ListA, ListB

# ---- group: ASSEMBLY / PREPARING DATA / DEPTHS (Z VALUES)
dispatch_2 = Dispatch(List=expression, DispatchPattern=equals_2.Equality)  # -> ListA, ListB

# ---- group: ASSEMBLY / PREPARING DATA / LONGEST CURVE IS OUTSIDE
len_2 = Length(Curve=dispatch.ListA)
sort = SortList(Keys=len_2, ValuesA=dispatch.ListA, ValuesB=dispatch_2.ListA)  # -> Keys, reverse(ValuesA), reverse(ValuesB)

# ---- group: ASSEMBLY / POCKETS
item_5 = ListItem(List=sort.ValuesA, Index=1, Wrap=False)
item_6 = ListItem(List=sort.ValuesB, Index=1, Wrap=False)
merge_7 = Merge(Data1=dispatch.ListB, Data2=item_5)
merge_8 = Merge(Data1=dispatch_2.ListB, Data2=item_6)
clean_3 = CleanTree(RemoveNulls=True, RemoveInvalid=True, RemoveEmpty=True, Tree=merge_7)
clean_4 = CleanTree(RemoveNulls=True, RemoveInvalid=True, RemoveEmpty=True, Tree=merge_8)

# ---- group: ASSEMBLY / OUTSIDE CUTS
item_7 = ListItem(List=sort.ValuesB, Index=0, Wrap=True)
item_8 = ListItem(List=sort.ValuesA, Index=0, Wrap=True)

clean_5 = CleanTree(RemoveNulls=True, RemoveInvalid=True, RemoveEmpty=True, Tree=item_8)
clean_6 = CleanTree(RemoveNulls=True, RemoveInvalid=True, RemoveEmpty=True, Tree=item_7)

# ---- group: PREPARING DATA / GEOMETRY
dispatch_3 = Dispatch(List=clean_2, DispatchPattern=equals_3.Equality)  # -> ListA, ListB

# ---- group: PREPARING DATA / DEPTHS (Z VALUES)
dispatch_4 = Dispatch(List=expression_2, DispatchPattern=equals_3.Equality)  # -> ListA, ListB

# ---- group: ASSEMBLY / FindCenterPointOfConnectionFeature
len_3 = Length(Curve=merge_7)
equalst = EqualityWithinTolerance(FirstNumber=len_3, SecondNumber="105.33", Tolerance=0.01)  # -> Equality, Inequality
equalst_2 = EqualityWithinTolerance(FirstNumber=len_3, SecondNumber="112.92", Tolerance=0.01)  # -> Equality, Inequality
equalst_3 = EqualityWithinTolerance(FirstNumber=len_3, SecondNumber="217.67", Tolerance=0.01)  # -> Equality, Inequality
or = GateOr(C=equalst_2.Equality, A=equalst_3.Equality, B=equalst.Equality)
cull = CullPattern(List=merge_7, CullPattern=or)
area = Area(Geometry=cull)  # -> Area, Centroid
pdecon_3 = Deconstruct(Point=area.Centroid)  # -> XComponent, YComponent, ZComponent

# ---- group: PREPARING DATA / LONGEST CURVE IS OUTSIDE
len_4 = Length(Curve=dispatch_3.ListA)
sort_2 = SortList(Keys=len_4, ValuesA=dispatch_3.ListA, ValuesB=dispatch_4.ListA)  # -> Keys, reverse(ValuesA), reverse(ValuesB)

# ---- group: STORYES HEIGHT
panel_6 = Panel("30")

# ---- group: ASSEMBLY / 3D GEOMET
xy = XYPlane(Origin=Point(0, 0, 0))
geo_9 = Geometry(dispatch.ListB)
geo_10 = Geometry(dispatch.ListA)
project = Project(Geometry=geo_10, Plane=xy)  # -> Geometry, Transform
boundary = BoundarySurfaces(Edges=geo_9)
boundary_2 = BoundarySurfaces(Edges=project.Geometry)
evalsrf = EvaluateSurface(Surface=reparameterize(boundary), Point=Point(0.5, 0.5, 0))  # -> Point, Normal, UDirection, VDirection, Frame
evalsrf_2 = EvaluateSurface(Surface=reparameterize(boundary_2), Point=Point(0.5, 0.5, 0))  # -> Point, Normal, UDirection, VDirection, Frame
pdecon_4 = Deconstruct(Point=evalsrf.Point)  # -> XComponent, YComponent, ZComponent
pdecon_5 = Deconstruct(Point=evalsrf_2.Point)  # -> XComponent, YComponent, ZComponent
subtraction = Subtraction(A=pdecon_4.ZComponent, B=panel_6)
Z = UnitZ(Factor=expr("30-x", pdecon_5.ZComponent))
Z_2 = UnitZ(Factor=expr("-x", subtraction))
extr = Extrude(Base=boundary_2, Direction=Z)
extr_2 = Extrude(Base=boundary, Direction=Z_2)
sdiff = SolidDifference(BrepsA=extr, BrepsB=extr_2)
cluster_3 = Cluster_4(G=simplify(extr_2), G_2=simplify(extr))
bool = Boolean(False)
nullrep = ReplaceNulls(Items=cluster_3, Replacements=bool)  # -> Items, Count
dispatch_5 = Dispatch(List=extr, DispatchPattern=nullrep.Count)  # -> ListA, ListB
dispatch_6 = Dispatch(List=sdiff, DispatchPattern=nullrep.Count)  # -> ListA, ListB
Z_3 = UnitZ(Factor=expr("-x", panel_6))
geo_11 = Geometry([dispatch_5.ListA, dispatch_6.ListB])
move = Move(Geometry=geo_11, Motion=Z_3)  # -> Geometry, Transform

# ---- group: POCKETS
item_9 = ListItem(List=sort_2.ValuesA, Index=1, Wrap=False)
item_10 = ListItem(List=sort_2.ValuesB, Index=1, Wrap=False)
merge_9 = Merge(Data1=dispatch_3.ListB, Data2=item_9)
merge_10 = Merge(Data1=dispatch_4.ListB, Data2=item_10)
clean_7 = CleanTree(RemoveNulls=True, RemoveInvalid=True, RemoveEmpty=True, Tree=merge_9)
clean_8 = CleanTree(RemoveNulls=True, RemoveInvalid=True, RemoveEmpty=True, Tree=merge_10)

# ---- group: OUTSIDE CUTS
item_11 = ListItem(List=sort_2.ValuesB, Index=0, Wrap=True)
item_12 = ListItem(List=sort_2.ValuesA, Index=0, Wrap=True)

clean_9 = CleanTree(RemoveNulls=True, RemoveInvalid=True, RemoveEmpty=True, Tree=item_12)
clean_10 = CleanTree(RemoveNulls=True, RemoveInvalid=True, RemoveEmpty=True, Tree=item_11)

# ---- group: ENGRAVING
fontsize = Slider(10, range=0..100)
italic = BooleanToggle(False)
cluster_4 = Cluster_3()  # -> flatten(R)
clean_11 = CleanTree(RemoveNulls=True, RemoveInvalid=True, RemoveEmpty=True, Tree=pt_2)
font = ShapeDiverTextInput(maxlength=100, text="Helvetica Neue")
location = Point(clean_11)
font_2 = Font(Family=font, Size=fontsize, Bold=False, Italic=False, Underline=False)
textc = TextCurves(Plane=location, Text=panel_2, Font=font_2)
rotate_4 = Rotate(Geometry=textc, Angle=1.570796327, Plane=location)  # -> Geometry, Transform
bbox = BoundingBox(Content=rotate_4.Geometry, Plane=PlaneXY(0, 0, 0), UnionBox=True)  # -> Box, Box_2
area_2 = Area(Geometry=bbox.Box)  # -> Area, Centroid
move2pt_3 = MoveToPoint(Geometry=rotate_4.Geometry, PointA=area_2.Centroid, PointB=location)  # -> Moved, Vector, Transform
xy_2 = XYPlane(Origin=Point(0, 0, 0))
crv_4 = Curve(move2pt_3.Moved)
project_2 = Project(Geometry=crv_4, Plane=xy_2)  # -> Geometry, Transform

# ---- group: 3D GEOMET
xy_3 = XYPlane(Origin=Point(0, 0, 0))
geo_12 = Geometry(dispatch_3.ListB)
geo_13 = Geometry(dispatch_3.ListA)
project_3 = Project(Geometry=geo_13, Plane=xy_3)  # -> Geometry, Transform
boundary_3 = BoundarySurfaces(Edges=geo_12)
boundary_4 = BoundarySurfaces(Edges=project_3.Geometry)
evalsrf_3 = EvaluateSurface(Surface=reparameterize(boundary_3), Point=Point(0.5, 0.5, 0))  # -> Point, Normal, UDirection, VDirection, Frame
evalsrf_4 = EvaluateSurface(Surface=reparameterize(boundary_4), Point=Point(0.5, 0.5, 0))  # -> Point, Normal, UDirection, VDirection, Frame
pdecon_6 = Deconstruct(Point=evalsrf_3.Point)  # -> XComponent, YComponent, ZComponent
pdecon_7 = Deconstruct(Point=evalsrf_4.Point)  # -> XComponent, YComponent, ZComponent
subtraction_2 = Subtraction(A=pdecon_6.ZComponent, B=panel_6)
Z_4 = UnitZ(Factor=expr("30-x", pdecon_7.ZComponent))
Z_5 = UnitZ(Factor=expr("-x", subtraction_2))
extr_3 = Extrude(Base=boundary_4, Direction=Z_4)
extr_4 = Extrude(Base=boundary_3, Direction=Z_5)
sdiff_2 = SolidDifference(BrepsA=extr_3, BrepsB=extr_4)
cluster_5 = Cluster_4(G=simplify(extr_4), G_2=simplify(extr_3))
bool_2 = Boolean(False)
nullrep_2 = ReplaceNulls(Items=cluster_5, Replacements=bool_2)  # -> Items, Count
dispatch_7 = Dispatch(List=extr_3, DispatchPattern=nullrep_2.Count)  # -> ListA, ListB
dispatch_8 = Dispatch(List=sdiff_2, DispatchPattern=nullrep_2.Count)  # -> ListA, ListB
Z_6 = UnitZ(Factor=expr("-x", panel_6))
geo_14 = Geometry([dispatch_7.ListA, dispatch_8.ListB])
move_2 = Move(Geometry=geo_14, Motion=Z_6)  # -> Geometry, Transform

# ---- group: LAYER NAME
subtraction_3 = Subtraction(A=panel_6, B=clean_10)
subtraction_4 = Subtraction(B=clean_8)
subtraction_5 = Subtraction(A=panel_6, B=crv_4)
abs = Absolute(Value=subtraction_4)
expression_3 = Expression(x=subtraction_3, Expression="Format (\"OC-0.20-1\",x}")
expression_4 = Expression(x=subtraction_5, Expression="Format (\"E-29.8-2\",x}")
expression_5 = Expression(x=abs, Expression="Format (\"IP-{0:0.00}-1\",x}")
dup = DuplicateData(Data="SHEET", Number=lng, Order=True)
merge_11 = Merge(Data1=flatten(expression_3), Data2=flatten(expression_5), Data3=flatten(dup))

# ---- group: GEOMETRY
merge_12 = Merge(Data1=flatten(clean_9), Data2=flatten(clean_7), Data3=flatten(filter_9), Data4=flatten(project_2.Geometry))
project_4 = Project(Geometry=merge_12, Plane=PlaneXY(0, 0, 0))  # -> Geometry, Transform
merge_13 = Merge(Data1=project_4.Geometry, Data2=flatten(move_2.Geometry))  # -> flatten(Result)
geo_15 = Geometry(project_4.Geometry)

# ---- group: LAYER COLOR
lng_2 = ListLength(List=flatten(clean_10))
lng_3 = ListLength(List=flatten(clean_8))
lng_4 = ListLength(List=flatten(lng))
lng_5 = ListLength(List=flatten(project_2.Geometry))
lng_6 = ListLength(List=flatten(move_2.Geometry))
outsidecut = ColourSwatch(SwatchColor=RGB(199, 27, 0))
pockets = ColourSwatch(SwatchColor=RGB(88, 208, 255))
sheet = ColourSwatch(SwatchColor=RGB(96, 98, 97))
engrave = ColourSwatch(SwatchColor=RGB(189, 255, 72))
_3dgeo = ColourSwatch(SwatchColor=RGBA(150, 150, 150, 0))
dup_2 = DuplicateData(Data=outsidecut, Number=lng_2, Order=True)
dup_3 = DuplicateData(Data=pockets, Number=lng_3, Order=True)
dup_4 = DuplicateData(Data=sheet, Number=lng_4, Order=True)
dup_5 = DuplicateData(Data=engrave, Number=lng_5, Order=True)
dup_6 = DuplicateData(Data=_3dgeo, Number=lng_6, Order=True)
merge_14 = Merge(Data1=flatten(dup_2), Data2=flatten(dup_3), Data3=flatten(dup_4), Data4=flatten(dup_5))  # -> flatten(Result)

# ---- group: EXPORT DXF
expression_6 = Expression(x=panel_2, Expression="Format(\"{0}.dxf\", x)")
purge = GhPythonScript()  # -> out, a
# ---------- purge: Python ----------
import rhinoscriptsyntax as rs
import scriptcontext as sc
if x:
    rs.Command("_Purge _Enter",True)
# ---------- end purge ----------
cset = CreateSet(List=merge_11)  # -> Set, Map
gh_dir = PythonScript(x=panel)  # -> a
# ---------- gh_dir: Python ----------
__author__ = "moryde"

import rhinoscriptsyntax as rs
import os

a = os.path.dirname(ghdoc.Path) + "\\" + x
# ---------- end gh_dir ----------
terrainshadingmask = Gismo_TerrainShadingMask(fileName=expression_6, fileFolderPath=gh_dir, layers=cset.Set, runIt=export_dxf)  # -> readMe; inputs layers: list, runIt: Boolean
# ---------- terrainshadingmask: Python ----------
# export geometry to a file, from chosen layers
# mar 01 2017, issworld2000@yahoo.com

"""
Use this component to export geometry from certain Rhino layers to a single file (.dwg, .dxf ...)
-
    input:
        _fileName: Name AND EXTENSION of the exported file.
                   For example: "someFile.dwg"
        _fileFolderPath: Folder path of the exported file.
                         For example: "C:\some Folder\new sub Folder"
        _layers: List of layer names from which you would like to export geometry to a file.
        _runIt: Set to "True" to run the component.
    
    output:
        readMe!: ...
"""

ghenv.Component.Name = "Gismo_Terrain Shading Mask"
ghenv.Component.NickName = "TerrainShadingMask"

import rhinoscriptsyntax as rs
import scriptcontext as sc
import Rhino
import os

def exportByLayer(fileName, fileFolderPath, layerNames):
    
    if not os.path.isdir(fileFolderPath):
        os.mkdir(fileFolderPath)
    fileNameFolderPath = os.path.join(fileFolderPath, fileName)
    
    sc.doc = Rhino.RhinoDoc.ActiveDoc
    selectTheObjects = True
    for layerName in layerNames:
        objIds_perLayer = rs.ObjectsByLayer(layerName, selectTheObjects)  # select the geometires for export
    
    fileNameFolderPath2 = chr(34) + fileNameFolderPath + chr(34)
    commandString = "_-Export " + fileNameFolderPath2 + " _Enter _Enter _Enter"
    
    echo = False
    done = rs.Command(commandString, echo)
    if done:
        print "Geometry Written to DXF to: %s" % (fileNameFolderPath)
    else:
        print "Something went wrong. Export terminated"
    
    #rs.UnselectAllObjects()
    
    sc.doc = ghdoc


if _runIt:
    if (_fileName != None) and (_fileFolderPath != None) and (len(_layers) > 0):
        exportByLayer(_fileName, _fileFolderPath, _layers)
    else:
        print "Some the \"_fileName \" or \"_fileFolderPath\" or \"_layers\" inputs does not have a required value added to it."
# ---------- end terrainshadingmask ----------

# ---- group: STATUS
panel_7 = Panel(terrainshadingmask)

# ---- group: SHAPEDIVER EXPORT
sdpropertiesexport = ShapeDiverPropertiesExport(SDName="beeHomeStatic", SDLayer=merge_11, SDColor=merge_14, SDPlotColor=merge_14)
sdsetproperties = ShapeDiverSetProperties(Object=merge_13, Properties=sdpropertiesexport)
filename = ShapeDiverTextInput(maxlength=100, text="Default")
dxfdownload = ShapeDiverExportDownload(Data=sdsetproperties, Format="dxf", Name=filename)

# ---- group: DISPLAY
qb = QuickBaker(Geometry=geo_15, Layer=merge_11, Bake=show_export, referenceAll=1)
preview = CustomPreview(Geometry=geo_15, Material=merge_14)
preview_2 = CustomPreview(Geometry=move_2.Geometry, Material=ColourSwatch(SwatchColor=RGB(255, 255, 255)))

# ---- group: ASSEMBLY / MoveToAssembly
lng_7 = ListLength(List=flatten(move.Geometry))
series = Series(Start=0, Step="-30", Count=lng_7)
neg = Negative(Value="-30")
pt_3 = ConstructPoint(XCoordinate=pdecon_3.XComponent, YCoordinate=pdecon_3.YComponent, ZCoordinate=0)

# ---- group: ASSEMBLY
panel_8 = Panel("100")
panel_9 = Panel("-100")
subtraction_6 = Subtraction(A=lng_7, B=1)

# ---- group: ASSEMBLY / MoveToAssembly (continued)
multiplication = Multiplication(A=neg, B=subtraction_6)
pt_4 = ConstructPoint(XCoordinate=panel_9, YCoordinate=panel_8, ZCoordinate=series)
vec = VectorXYZ(XComponent=0, YComponent=0, ZComponent=multiplication)  # -> Vector, Length
move2pt_4 = MoveToPoint(Geometry=flatten(move.Geometry), PointA=flatten(pt_3), PointB=pt_4)  # -> Moved, Vector, Transform
line = LineSDL(Start=pt_4, Direction=Vector(1, 0, 0), Length=1)
rotax = RotateAxis(Geometry=move2pt_4.Moved, Angle=3.141592654, Axis=line)  # -> Geometry, Transform
move_3 = Move(Geometry=rotax.Geometry, Motion=vec.Vector)  # -> Geometry, Transform

# ---- group: AssembledBeeHome
geo_16 = Geometry(move_3.Geometry)

# ----
preview_3 = CustomPreview(Geometry=geo_16, Material=ColourSwatch(SwatchColor=RGB(167, 135, 77)))

# ==== cluster Cluster
T = ClusterInput()
rep = ReplaceText(Text=T, Find="A", Replace="1", RecursiveReplace=False)
rep_2 = ReplaceText(Text=rep, Find="B", Replace="2", RecursiveReplace=False)
rep_3 = ReplaceText(Text=rep_2, Find="C", Replace="3", RecursiveReplace=False)
rep_4 = ReplaceText(Text=rep_3, Find="D", Replace="4", RecursiveReplace=False)
rep_5 = ReplaceText(Text=rep_4, Find="E", Replace="5", RecursiveReplace=False)
rep_6 = ReplaceText(Text=rep_5, Find="F", Replace="6", RecursiveReplace=False)
rep_7 = ReplaceText(Text=rep_6, Find="G", Replace="7", RecursiveReplace=False)
rep_8 = ReplaceText(Text=rep_7, Find="H", Replace="8", RecursiveReplace=False)
rep_9 = ReplaceText(Text=rep_8, Find="I", Replace="9", RecursiveReplace=False)
rep_10 = ReplaceText(Text=rep_9, Find="J", Replace="10", RecursiveReplace=False)
rep_11 = ReplaceText(Text=rep_10, Find="K", Replace="11", RecursiveReplace=False)
rep_12 = ReplaceText(Text=rep_11, Find="L", Replace="12", RecursiveReplace=False)
rep_13 = ReplaceText(Text=rep_12, Find="M", Replace="13", RecursiveReplace=False)
rep_14 = ReplaceText(Text=rep_13, Find="N", Replace="14", RecursiveReplace=False)
rep_15 = ReplaceText(Text=rep_14, Find="O", Replace="15", RecursiveReplace=False)
rep_16 = ReplaceText(Text=rep_15, Find="P", Replace="16", RecursiveReplace=False)
rep_17 = ReplaceText(Text=rep_16, Find="Q", Replace="17", RecursiveReplace=False)
R = ClusterOutput(rep_17)

# ==== cluster Cluster_2
C = ClusterInput()
bbox = BoundingBox(Content=C, Plane=PlaneXY(0, 0, 0))  # -> Box, Box_2
debox = DeconstructBox(Box=bbox.Box)  # -> Plane, X, Y, Z
rectangle = Rectangle(Plane=PlaneXY(0, 0, 0), XSize=debox.X, YSize=debox.Y, Radius=0)  # -> Rectangle, Length
crv = Curve(rectangle.Rectangle)
crv_2 = ClusterOutput(crv)

# ==== cluster NewSpine
A = ClusterInput()
geo = Geometry(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)
geo_2 = Geometry(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)
geo_3 = Geometry(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)
multiplication = Multiplication(A=A, B=Slider(30, range=0..100))
addition = Addition(A=multiplication)
Y = UnitY(Factor=multiplication)
X = UnitX(Factor=addition)
move = Move(Geometry=geo_3, Motion=X)  # -> Geometry, Transform
move_2 = Move(Geometry=geo, Motion=X)  # -> Geometry, Transform
end = EndPoints(Curve=geo_2)  # -> Start, End
line = LineSDL(Start=[end.Start, end.End], Direction=X, Length=X)
geo_4 = Geometry()
join = JoinCurves(Curves=flatten([geo_2, move_2.Geometry, line]), Preserve=False)
crv = Curve(move.Geometry)
area = Area(Geometry=join)  # -> Area, Centroid
geo_5 = Geometry(simplify(flatten([join, crv])))
Z = UnitZ(Factor=area.Centroid)
line_2 = LineSDL(Start=area.Centroid, Direction=Z, Length=Z)
rotax = RotateAxis(Geometry=geo_5, Angle=1.570796327, Axis=line_2)  # -> Geometry, Transform
curvespine = Geometry(rotax.Geometry)
Z_2 = UnitZ(Factor="30")
move_3 = Move(Geometry=curvespine, Motion=Z_2)  # -> Geometry, Transform
boundary = BoundarySurfaces(Edges=curvespine)
Z_3 = UnitZ(Factor=Slider(30, range=0..100))
curve = ClusterOutput(move_3.Geometry)
extr = Extrude(Base=boundary, Direction=Z_3)
brep = ClusterOutput(extr)

# ==== cluster Spike
F = ClusterInput()
xy = XYPlane(Origin=Point(0, 0, 0))
geo = Geometry(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)
geo_2 = Geometry(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)
project = Project(Geometry=geo_2, Plane=xy)  # -> Geometry, Transform
project_2 = Project(Geometry=geo, Plane=xy)  # -> Geometry, Transform
Y = UnitY(Factor=F)
move = Move(Geometry=project.Geometry, Motion=Y)  # -> Geometry, Transform
end = EndPoints(Curve=project_2.Geometry)  # -> Start, End
line = LineSDL(Start=[end.Start, end.End], Direction=Y, Length=Y)
join = JoinCurves(Curves=flatten([project_2.Geometry, move.Geometry, line]), Preserve=False)
Z = UnitZ(Factor="30")
move_2 = Move(Geometry=join, Motion=Z)  # -> Geometry, Transform
boundary = BoundarySurfaces(Edges=move_2.Geometry)
Z_2 = UnitZ(Factor=Slider(30, range=0..100))
dup = DuplicateData(Data=move_2.Geometry, Number=2, Order=True)
extr = Extrude(Base=boundary, Direction=expr("-x", Z_2))
curve = ClusterOutput(move_2.Geometry)
dup_2 = DuplicateData(Data=extr, Number=2, Order=True)
_3dspine = ClusterOutput(extr)

# ==== cluster Cluster_3
T = ClusterInput()
rep = ReplaceText(Text=T, Find="0", RecursiveReplace=False)
rep_2 = ReplaceText(Text=rep, Find="1", RecursiveReplace=False)
rep_3 = ReplaceText(Text=rep_2, Find="2", RecursiveReplace=False)
rep_4 = ReplaceText(Text=rep_3, Find=",", RecursiveReplace=False)
F = ClusterInput()
rep_5 = ReplaceText(Text=rep_4, Find=F, RecursiveReplace=False)
F_2 = ClusterInput()
F_3 = ClusterInput()
rep_6 = ReplaceText(Text=rep_5, Find=F_2, RecursiveReplace=False)
rep_7 = ReplaceText(Text=rep_6, Find=F_3, RecursiveReplace=False)
R = ClusterOutput(rep_7)

# ==== cluster Cluster_4
G = ClusterInput()
G_2 = ClusterInput()
item = ListItem(List=G, Index="0", Wrap=True)
geo = Geometry(G)
area = Area(Geometry=G)  # -> Area, Centroid
area_2 = Area(Geometry=G_2)  # -> Area, Centroid
bbox = BoundingBox(Content=G_2, Plane=PlaneXY(0, 0, 0))  # -> Box, Box_2
geo_2 = Geometry(G_2)
pdecon = Deconstruct(Point=area_2.Centroid)  # -> XComponent, YComponent, ZComponent
pdecon_2 = Deconstruct(Point=area.Centroid)  # -> XComponent, YComponent, ZComponent
brepinc = PointInBrep(Brep=bbox.Box, Point=area.Centroid, Strict=False)
cset = CreateSet(List=flatten(pdecon_2.XComponent))  # -> Set, Map
round = Round(Number=pdecon.XComponent)  # -> Nearest, Floor, Ceiling
and = GateAnd()
item_2 = ListItem(List=brepinc, Index=Slider(0, range=0..10), Wrap=True)
round_2 = Round(Number=cset.Set)  # -> Nearest, Floor, Ceiling
python = GhPythonScript(x=round.Nearest, y=round_2.Nearest)  # -> out, a; inputs x: list, y: list
# ---------- python: Python ----------
__author__ = "mortenydefeldt"

import rhinoscriptsyntax as rs

a = []
b = False
for X in x:
    b = False
    for Y in y:
        if Y == X:
            b = True
            print "HELLLLLLLLLO TRUE"
    a.append(b)
    b = False
# ---------- end python ----------
panel = Panel(item_2)
i = ClusterOutput(item_2)

# ==== cluster Legs
A = ClusterInput()
subtraction = Subtraction(A=A, B=4)
geo = Geometry([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])
geo_2 = Geometry([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])
Y = UnitY(Factor=subtraction)
move = Move(Geometry=geo_2, Motion=Y)  # -> Geometry, Transform
end = EndPoints(Curve=geo)  # -> Start, End
line = LineSDL(Start=[end.Start, end.End], Direction=Y, Length=Y)
Z = UnitZ(Factor="-30")
join = JoinCurves(Curves=flatten([move.Geometry, line, geo]), Preserve=False)
curvespine = Geometry(join)
move_2 = Move(Geometry=curvespine, Motion=Z)  # -> Geometry, Transform
Z_2 = UnitZ(Factor=Slider(30, range=0..100))
boundary = BoundarySurfaces(Edges=move_2.Geometry)
number_slider = Slider(2, range=0..10)
extr = Extrude(Base=boundary, Direction=expr("-x", Z_2))
dup = DuplicateData(Data=move_2.Geometry, Number=number_slider, Order=True)
dup_2 = DuplicateData(Data=extr, Number=number_slider, Order=True)
D = ClusterOutput(dup)
D_2 = ClusterOutput(dup_2)

# ==== cluster MoveGeometryToZero
C = ClusterInput()
bbox = BoundingBox(Content=C, Plane=PlaneXY(0, 0, 0))  # -> Box, Box_2
box_corners = BoxCorners(Box=bbox.Box)  # -> CornerA, CornerB, CornerC, CornerD, CornerE, CornerF, CornerG, CornerH
geo = Geometry(box_corners.CornerA)
geo_2 = ClusterOutput(geo)

# ==== cluster DEFAULTINPUTGEOMETRIES
geo = ClusterInput()
geo_2 = Geometry(geo)
area = Area(Geometry=geo_2)  # -> Area, Centroid
sort = SortList(Keys=area.Area, ValuesA=geo_2)  # -> Keys, reverse(ValuesA)
item = ListItem(List=sort.ValuesA, Index=0, Wrap=True)
bbox = BoundingBox(Content=item, Plane=PlaneXY(0, 0, 0))  # -> Box, Box_2
replace = ReplaceItems(List=simplify(sort.ValuesA), Item=bbox.Box, Indices=0, Wrap=False)
geo_3 = Geometry(replace)
geo_4 = ClusterOutput(geo_3)
